# Grasshopper definition holes_script.gh (Grasshopper 1.0.8)
# plug-ins: RhinoCodePluginGH

volumefactor = Slider(0.606, range=-1..3)
pathtoevolverdir = Panel("C:\Evolver\")
interactivemode = BooleanToggle(False)
boundryconditionmesh_s = Mesh(<mesh referenced from the Rhino model>)
startingshapemesh = Mesh(<mesh referenced from the Rhino model>)
runonchange = BooleanToggle(False)
refinmentiterations = Integer(3)
gradientsteps = Integer(25)
py3 = Python3Script(
    input_mesh=startingshapemesh,
    RUN_ON_CHANGE=runonchange,
    G_INPUT=gradientsteps,
    R_INPUT=refinmentiterations,
    VOLUME_FACTOR=volumefactor,
    INTER_ACTIVE=interactivemode,
    BASE_PATH=pathtoevolverdir)  # -> out, result_mesh, result_fixed; inputs input_mesh: Mesh, input_boundary_conditions: list of Mesh, RUN_ON_CHANGE: Boolean, G_INPUT: Int32, R_INPUT: Int32, VOLUME_FACTOR: Double, INTER_ACTIVE: Boolean
# ---------- py3: Python ----------
import sys
import os
import datetime
import rhinoscriptsyntax as rs
if not BASE_PATH:
    BASE_PATH = r"C:\Evolver"
sys.path.append(os.path.join(BASE_PATH,"surface_evolver_grasshopper"))
sys.path.append(os.path.join(BASE_PATH,"surface_evolver_grasshopper", "py_lib"))
import se_grasshopper_entery
se_grasshopper_entery.reload_all_modules()

if RUN_ON_CHANGE and input_mesh:


    if not VOLUME_FACTOR:
        VOLUME_FACTOR = 0.5
    if not INTER_ACTIVE:
        INTER_ACTIVE = False
    if not G_INPUT:
        G_INPUT = 20
    if not R_INPUT:
        R_INPUT = 2
    if not input_boundary_conditions:
        input_boundary_conditions = []

    arguments = {
        "VOLUME_FACTOR": VOLUME_FACTOR,
        "INTER_ACTIVE": INTER_ACTIVE,
        "G_INPUT": G_INPUT,
        "R_INPUT": R_INPUT,
        "BASE_PATH": BASE_PATH,
        "input_mesh": input_mesh,
        "input_boundary_conditions": input_boundary_conditions,
        "result_mesh": {"verts":[], "faces":[]},
        "result_fixed": {"verts":[], "faces":[]}
    }
    
    se_grasshopper_entery.run_SE(arguments)
    result_mesh = rs.AddMesh(arguments["result_mesh"]["verts"], arguments["result_mesh"]["faces"])
    if arguments["result_fixed"]["verts"] and arguments["result_fixed"]["faces"] :
        result_fixed = rs.AddMesh(arguments["result_fixed"]["verts"], arguments["result_fixed"]["faces"])
else:
    print("Not running script until 'RUN_ON_CHANGE' is true and 'input_mesh' is set")
# ---------- end py3 ----------
outputlog = Panel(py3.out)
fullshapeoutput = Mesh(py3.result_mesh)
fixedfacesoutput = Mesh(py3.result_fixed)
